% Simulink data dictionary plantDynamicsDictionary.sldd

MASS = Simulink.Parameter(1, DataType="double", Unit="kg")  % The mass of the vehicle.
q_body_NED_init = Simulink.Parameter([0 0 0 1], DataType="double")  % Initial quaternion representing the orientation of the vehicle in the NED frame.
v_NED_init = Simulink.Parameter([0 0 0], DataType="double")
x_ECEF_init = Simulink.Parameter([0 0 0], DataType="double")